# Dynamo graph AllplanAttributeCollection-Example.dyn (Dynamo 2.5.0.7186)
# packages: IL-SE-Dynamo 0.1.0

file_path = Filename("H:\Workbench\Dynamo\Allplan\AttributeDefinitionCollectionAllplan_de.xml")
byFileName = Allplan.AttributeDefinition.ByFileName(fileName=file_path)
toData = Allplan.AttributeDefinition.ToData(attributeDefinition=byFileName)
watch = Watch(toData.ifnr)
watch_2 = Watch(toData.name)
file_path_2 = Filename("out\AttributeCollectionMerged.xlsx")
code_block = CodeBlock { "Konflikte"; }
code_block_2 = CodeBlock { 0; 1; }
file_path_3 = Filename("H:\Workbench\Dynamo\Allplan\AttributeDefinitionCollectionLocal_de.xml")
byFileName_2 = Allplan.AttributeDefinition.ByFileName(fileName=file_path_3)
diff = Allplan.AttributeDefinition.Diff(left=byFileName, right=byFileName_2)
toData_2 = Allplan.AttributeDefinition.ToData(attributeDefinition=diff.leftConflicts)
code_block_3 = CodeBlock(ifnr=toData_2.ifnr, name=toData_2.name, datatype=toData_2.datatype, parentGroup=toData_2.parentGroup) { [ifnr, name, datatype, parentGroup]; }
transpose = List.Transpose(lists=code_block_3)
exportExcel = Data.ExportExcel(filePath=file_path_2, sheetName=code_block, startRow=code_block_2.out1, startCol=code_block_2.out0, data=transpose)
watch_3 = Watch(exportExcel)
code_block_4 = CodeBlock { "Gesamt"; }
throwExceptionOnFirst = Allplan.MergeStrategy.ThrowExceptionOnFirst()
merge = Allplan.AttributeDefinition.Merge(left=byFileName, right=byFileName_2, mergeStrategy=throwExceptionOnFirst)
toData_3 = Allplan.AttributeDefinition.ToData(attributeDefinition=merge.attributeDefintion)
code_block_5 = CodeBlock(ifnr=toData_3.ifnr, name=toData_3.name, datatype=toData_3.datatype, parentGroup=toData_3.parentGroup) { [ifnr, name, datatype, parentGroup]; }
transpose_2 = List.Transpose(lists=code_block_5)
exportExcel_2 = Data.ExportExcel(filePath=file_path_2, sheetName=code_block_4, startRow=code_block_2.out1, startCol=code_block_2.out0, data=transpose_2)
watch_4 = Watch(exportExcel_2)
