# Dynamo graph AllplanAttributeFavourite-Example.dyn (Dynamo 2.5.0.7186)
# packages: IL-SE-Dynamo 0.1.0

file_path = Filename("out\AllplanAttributeFavourite-Example.xlsx")
file_path_2 = Filename("..\IlseDynamo.Tests\Resources\AttributeFavourite.atfanfx")
byFileName = Allplan.AttributeFavourite.ByFileName(fileName=file_path_2)
getName = Allplan.AttributeFavourite.GetName(attributeFavourite=byFileName)
code_block = CodeBlock { 0; 1; }
file_path_3 = Filename("H:\Workbench\Dynamo\Allplan\AttributeDefinitionCollectionAllplan_de.xml")
byFileName_2 = Allplan.AttributeDefinition.ByFileName(fileName=file_path_3)
file_path_4 = Filename("H:\Workbench\Dynamo\Allplan\AttributeDefinitionCollectionLocal_de.xml")
byFileName_3 = Allplan.AttributeDefinition.ByFileName(fileName=file_path_4)
throwExceptionOnFirst = Allplan.MergeStrategy.ThrowExceptionOnFirst()
merge = Allplan.AttributeDefinition.Merge(left=byFileName_2, right=byFileName_3, mergeStrategy=throwExceptionOnFirst)
toData = Allplan.AttributeFavourite.ToData(attributeFavourite=byFileName, attributeDefinition=merge.attributeDefintion)
code_block_2 = CodeBlock(name=toData.name, value=toData.value) { [name, value]; }
transpose = List.Transpose(lists=code_block_2)
exportExcel = Data.ExportExcel(filePath=file_path, sheetName=getName, startRow=code_block.out1, startCol=code_block.out0, data=transpose)
watch = Watch(exportExcel)
