# Dynamo graph AllplanAttributeLevel-Example.dyn (Dynamo 2.5.0.7186)
# packages: IL-SE-Dynamo 0.1.0

# group: Reading definition and favourite template
file_path = Filename("..\IlseDynamo.Tests\Resources\AttributeFavourite.atfanfx")
byFileName = Allplan.AttributeFavourite.ByFileName(fileName=file_path)
file_path_2 = Filename("H:\Workbench\Dynamo\Allplan\AttributeDefinitionCollectionAllplan_de.xml")
byFileName_2 = Allplan.AttributeDefinition.ByFileName(fileName=file_path_2)
file_path_3 = Filename("H:\Workbench\Dynamo\Allplan\AttributeDefinitionCollectionLocal_de.xml")
byFileName_3 = Allplan.AttributeDefinition.ByFileName(fileName=file_path_3)
throwExceptionOnFirst = Allplan.MergeStrategy.ThrowExceptionOnFirst()
merge = Allplan.AttributeDefinition.Merge(left=byFileName_2, right=byFileName_3, mergeStrategy=throwExceptionOnFirst)

# group: LOI Definition
code_block = CodeBlock { [1,2,3]; }
code_block_2 = CodeBlock { ["Umbaukategorie","Betonstahl", "Regelwerk"]; }
byData = Allplan.AttributeMatrix.ByData(levels=code_block, attributeNames=code_block_2)
code_block_3 = CodeBlock { [1,2,3]; }
allUpToLevel = Allplan.AttributeMatrix.AllUpToLevel(attributeMatrix=byData, level=code_block_3)

ofLevel = Allplan.AttributeFavourite.OfLevel(attributeFavourite=byFileName, attributeLevel=allUpToLevel, attributeDefinition=merge.attributeDefintion)
toData = Allplan.AttributeFavourite.ToData(attributeFavourite=ofLevel)
watch = Watch(toData.ifnr)
watch_2 = Watch(toData.value)
toData_2 = Allplan.AttributeFavourite.ToData(attributeFavourite=ofLevel, attributeDefinition=merge.attributeDefintion)
watch_3 = Watch(toData_2.name)
watch_4 = Watch(toData_2.value)
