# Dynamo graph GGU-Data-Export-Excel.dyn (Dynamo 2.12.0.5650)
# packages: IlseDynamo 0.1.0

# group: Load XML
output_directory = Directory("C:\Users\krafbe\Downloads")
load_xml = Filename("..\IlseDynamo.Tests\Resources\GGUDrillingProfilesExample.xml")
output_xlsx_name = FileSystem.FileName(path=load_xml)
combinePath = FileSystem.CombinePath(string0=output_directory, string1=output_xlsx_name)
code_block = CodeBlock { "xlsx"; }
changePathExtension = FileSystem.ChangePathExtension(path=combinePath, newExtension=code_block)
code_block_2 = CodeBlock { "Profile"; }
byFileName = IlseDynamo.GGUStratig.DrillingProbes.ByFileName(fileName=load_xml)

# group: Assemble Header
code_block_3 = CodeBlock { ["Bezeichnung", "Rechtswert", "Hochwert", "Höhe"]; }
getMaxLayerCount = IlseDynamo.GGUStratig.DrillingProbes.GetMaxLayerCount(drillingProbes=byFileName)
code_block_4 = CodeBlock(t1=getMaxLayerCount) { 1..t1; }
code_block_5 = CodeBlock(t1=code_block_4) { ["Schicht "+t1, "Tiefe "+t1]; }
transpose = List.Transpose(lists=code_block_5)
flatten = List.Flatten(list=transpose)
join = List.Join(list0=code_block_3, list1=flatten)

# group: Aggregate profile data
getProbeData = IlseDynamo.GGUStratig.DrillingProbes.GetProbeData(drillingProbes=byFileName)
getName = IlseDynamo.GGUStratig.DrillingProbe.GetName(drillingProbe=getProbeData)
getPosition = IlseDynamo.GGUStratig.DrillingProbe.GetPosition(drillingProbe=getProbeData)
code_block_6 = CodeBlock(name=getName, p=getPosition) { [name, p.X, p.Y, p.Z]; }
getLayerInfo = IlseDynamo.GGUStratig.DrillingProbe.GetLayerInfo(drillingProbe=getProbeData)
transpose_2 = List.Transpose(lists=getLayerInfo)
getLayerDepth = IlseDynamo.GGUStratig.DrillingProbe.GetLayerDepth(drillingProbe=getProbeData)
transpose_3 = List.Transpose(lists=getLayerDepth)
code_block_7 = CodeBlock(l1=transpose_2, l2=transpose_3) { List.Transpose([ l1, l2 ]); }
code_block_8 = CodeBlock { 1; }
flatten_2 = List.Flatten(list=code_block_7, amount=code_block_8)
join_2 = List.Join(list0=code_block_6, list1=flatten_2)

# group: Export XLSX
code_block_9 = CodeBlock { 0; }
code_block_10 = CodeBlock(l1=join) { [l1]; }
transpose_4 = List.Transpose(lists=join_2)
join_3 = List.Join(list0=code_block_10, list1=transpose_4)
exportExcel = Data.ExportExcel(filePath=changePathExtension, sheetName=code_block_2, startRow=code_block_9, startColumn=code_block_9, data=join_3)

# group: Batch load XMLs
directory_path = Directory("Keine Datei ausgewählt.")
directory_from_path = DirectoryObject(path=directory_path)
code_block_11 = CodeBlock { "*.xml"; }
getDirectoryContents = FileSystem.GetDirectoryContents(directory=directory_from_path, searchString=code_block_11)
